vi "index.gviweb"   [G Web Development Software 22.3.0]
panel controls:
  "Exit (development only)": bool
  "Test Start": bool
  "Test Sequence": T3[]
  "Cancel": bool
panel indicators:
  "Test Duration (s)": f64
  "Step Status": T1[]
  "Program Log": string
  "Program Status": string
  "Initialized": bool
  "Finalized": bool
  "Graph": f64[][]
  "Result": bool
types:
  "Color.gtype" = u32
  T1 = cluster{"Progress": f64, "Result": "Color.gtype"}
  T2 = cluster{"Waveform": enum{"Constant", "Sawtooth", "Sinusoid"}, "Amplitude": f64, "Frequency": f64}
  T3 = cluster{"Duration (s)": f64, "Waveform Data": T2, "Fault Probability": f64}
  "Step Result.gtype" = enum{"Pass", "Fail", "Canceled"}
  "Step Status.gtype" = cluster{"Progress": f64, "Result": "Step Result.gtype", "Complete": bool}
  "Waveforms.gtype" = enum{"Constant", "Sawtooth", "Sinusoid"}
  "Waveform Data.gtype" = cluster{"Waveform": "Waveforms.gtype", "Amplitude": f64, "Frequency": f64}
  "Test Step Data.gtype" = cluster{"Duration (s)": f64, "Waveform Data": "Waveform Data.gtype", "Fault Probability": f64}
  "IO Data.gtype" = cluster{"Waveform": "Waveforms.gtype", "Duration (s)": f64, "Start Time": timestamp, "Time Factor": f64, "Adjusted Amplitude": f64, "New Wave": bool, "Wave Active": bool, "Fault start time": f64}
  "Manager State.gtype" = enum{"Idle", "Initialize", "Execute", "Finalize", "Cancel", "Error"}
  "Message Queue Names.gtype" = enum{"Manager", "UI", "IO"}
  "Step Data.gtype" = cluster{"Message Queue": "Message Queue Names.gtype", "Action": string}
  "Sequence.gtype" = cluster{"Manager State": "Manager State.gtype", "Steps": "Step Data.gtype"[]}
  "Manager Data.gtype" = cluster{"Current State": "Manager State.gtype", "Current Step": "Step Data.gtype", "Remaining Steps": "Step Data.gtype"[], "Remaining Sequences": "Sequence.gtype"[], "Current Instruction": string}
  "Error Data.gtype" = cluster{"Error Origin": "Message Queue Names.gtype", "Error In": error}
uses:
  WebApp::support::Message Queue::Create All Message Queues.gvi
  WebApp::support::Message Queue::Dequeue Message.gvi
  WebApp::UI::Define Preset Test Sequence.gviweb
  WebApp::UI::Prep Step Staus for Display.gviweb
  WebApp::UI::Calculate Test Duration.gviweb
  WebApp::UI::Validate Test Sequence.gviweb
  WebApp::program instructions::Report Step Complete.gviweb
  WebApp::UI::IO Data::Handle Data Remaining in Queue.gviweb
  WebApp::UI::Get Result Color.gviweb
  WebApp::UI::IO Data::Receive IO Data.gviweb
  WebApp::support::Generate Undefined Message Error.gviweb
  WebApp::support::Handle Error.gviweb
  WebApp::support::globals.gviweb
  WebApp::IO::Handle Next Waveform.gviweb
  WebApp::IO::Generate Waveform.gviweb
  WebApp::IO::Handle Hardware IO.gviweb
  WebApp::development::Check Test Sequence Complete.gviweb
  WebApp::program instructions::Define Program Instructions.gviweb
  WebApp::support::Message Queue::Enqueue Message (Single).gvi
  WebApp::UI::Messages::Append Log Text.gviweb
  WebApp::program instructions::Handle Next Sequence.gviweb
  WebApp::program instructions::Handle Next Step.gviweb
  NI::G Core::Error::Build Error Cluster.gvi
  WebApp::UI::Messages::Send Sequence Complete UI Updates.gviweb
  WebApp::UI::Messages::Update Program Status.gviweb
  WebApp::support::Error Handler - Event Handling Loop.gvi
diagram:
  # #development
  # #build
  Property Node(instance in=reference to "Exit (development only)", "Visible"=FALSE) -> (error out=w1)
  w2 = bool FALSE  # Stop Event
  Create User Event[EventName="Stop Event"](error in=w1, user event data type=w2) -> (error out=w3, user event out=w4)
  Obtain Queue(element data type=f64[] [], name="IO data") -> (error out=w5, queue out=w6)
  w7 = ["Manager", "UI", "IO"]  # Queue List
  # #feature_queue
  # Hardware fault
  # 	be able to clear error with corresponding case in IO
  # 	handle during initialize or execute
  # Abort
  # Pause
  # Pass initial instruction data to individual steps
  # Display test history/ data
  # Select between historical test data for display
  # 	Historical analysis/ comparison
  # Splining/ smooth transitions between waveforms
  # 	Force sawtooth to return to 0 before waveform transition?
  # Unit tests
  # Check for empty test sequence
  Array Size(array=w7) -> (size(s)=w8)
  call "Create All Message Queues.gvi"(Loop Count=w8, error in=w3) -> (Message Queues=w9, error out=w10)
  Array Index(array=w9) -> (out0["Manager"]=w11, out1["UI"]=w12)
  Merge Errors(w10, w5) -> (error out=w13)
  s1 = uninitialised  # shift register
  s2 = uninitialised  # shift register
  s3 = uninitialised  # shift register
  s4 = uninitialised  # shift register
  s5 = uninitialised  # shift register
  s6 = uninitialised  # shift register
  while {
    call "Dequeue Message.gvi"(message queue in=w12, timeout in milliseconds=s2, error in=w13) -> (timed out?=w14, message queue out=w15, message=w16, message data=w17, error out=w18)
    # UI Update Loop
    # s6: Step Index
    # s5: Test Steps
    # s2: Dequeue Timeout
    case (w16) ignore case {  # Message Cases
      frame "SW Init" {
        Property Node(instance in=reference to "Result", "Value"=FALSE, "Text"=[" ", " "])
        Property Node(instance in=reference to "Initialized", "Value"=FALSE)
        Property Node(instance in=reference to "Finalized", "Value"=FALSE)
        Property Node(instance in=reference to "Finalized", "Value"=FALSE)
        Property Node(instance in=reference to "Test Sequence", "Disabled"=FALSE)
        Property Node(instance in=reference to "Initialized", "Value"=FALSE, error in=w18) -> (error out=w27, instance out=w28)
        Property Node(instance in=reference to "Program Status", "Value"="Idle", error in=w18) -> (error out=w29, instance out=w30)
        Property Node(instance in=reference to "Program Log", "Value"="", error in=w18) -> (error out=w31, instance out=w32)
        Build Array(w28, w30, w32) -> w33
        Merge Errors(w27, w29, w31) -> (error out=w34)
        s7 = w34  # shift register
        for {
          w35 = each element of w33
          Close Reference(error in=s7, reference=w35) -> (error out=w36)
          next s7 = w36
        }
        call "Define Preset Test Sequence.gviweb"() -> (Preset Test Sequence=w37)
        Array Size(array=w37) -> (size(s)=w25)
        Initialize Array(element="Step Status.gtype" {all zero or empty}, size=w25) -> w24
        call "Prep Step Staus for Display.gviweb"(Steps status out=w24) -> (Step Status=w38)
        Property Node(instance in=reference to "Step Status", "Value"=w38)
        call "Calculate Test Duration.gviweb"(Test Sequences=w37) -> (Total Duration (s)=w39)
        Property Node(instance in=reference to "Test Duration (s)", "Value"=w39)
        Property Node(instance in=reference to "Test Sequence", "Value"=w37) -> (error out=w40)
        call "Validate Test Sequence.gviweb"(Input=reference to "Test Sequence", UI Queue=w15, data=w37, error in=w40)
        w19 = s7
        w20 = default
        w21 = ""
        w22 = -1
        w23 = f64[][] []
        w26 = 0
      }
      frame "Handle Test Change" {
        Variant To Data(error in (no error)=w18, type="Test Step Data.gtype"[] [], variant=w17) -> (data=w41, error out=w42)
        Array Size(array=w41) -> (size(s)=w25)
        call "Calculate Test Duration.gviweb"(Test Sequences=w41) -> (Total Duration (s)=w43)
        $"Test Duration (s)" <- w43
        call "Validate Test Sequence.gviweb"(Input=reference to "Test Sequence", UI Queue=w15, data=w41, error in=w42) -> (Error out=w19)
        w20 = default
        w21 = s1
        w22 = s2
        w23 = s3
        w24 = s4
        w26 = s6
      }
      frame "Execute" {
        # start polling to process data from IO loop
        call "Report Step Complete.gviweb"(Manager Queue=w11, This Queue Name="UI", Step Name=w16, Input_3=w18) -> (Output_2=w19)
        w20 = default
        w21 = s1
        w22 = 0
        w23 = s3
        w24 = s4
        w25 = s5
        w26 = s6
      }
      frame "Update Status" {
        Variant To Data(error in (no error)=w18, type=string "", variant=w17) -> (data=w44, error out=w19)
        Format Into String(formatString="%s\n%s", s1, w44) -> w21
        $"Program Log" <- w21
        w20 = default
        w22 = s2
        w23 = s3
        w24 = s4
        w25 = s5
        w26 = s6
      }
      frame "Update Program Status" {
        Variant To Data(error in (no error)=w18, type=w16, variant=w17) -> (data=w45, error out=w19)
        $"Program Status" <- w45
        w20 = default
        w21 = s1
        w22 = s2
        w23 = s3
        w24 = s4
        w25 = s5
        w26 = s6
      }
      frame "Initialize Complete" {
        $Initialized <- TRUE
        w19 = w18
        w20 = default
        w21 = s1
        w22 = s2
        w23 = s3
        w24 = s4
        w25 = s5
        w26 = s6
      }
      frame "Initialize" {
        Property Node(instance in=reference to "Result", "Value"=FALSE)
        Property Node(instance in=reference to "Test Sequence", "Disabled"=TRUE)
        Property Node(instance in=reference to "Initialized", "Value"=FALSE)
        Property Node(instance in=reference to "Finalized", "Value"=FALSE)
        # Enure at least 1 step is present
        Max And Min(x=s5, y=1) -> (max(x,y)=w46: i32)
        Initialize Array(element="Step Status.gtype" {all zero or empty}, size=w46) -> w24
        call "Prep Step Staus for Display.gviweb"(Steps status out=w24) -> (Step Status=w47)
        Property Node(instance in=reference to "Step Status", "Value"=w47, error in=w18) -> (error out=w48)
        call "Report Step Complete.gviweb"(Manager Queue=w11, This Queue Name="UI", Step Name=w16, Input_3=w48) -> (Output_2=w19)
        w20 = default
        w21 = s1
        w22 = s2
        w23 = f64[][] []
        w25 = s5
        w26 = 0
      }
      frame "Execute Complete" {
        # Handle any data remaining in queue
        call "Handle Data Remaining in Queue.gviweb"(Input_3=reference to "Graph", Input_2=reference to "Step Status", Input_4=w6, Input_5=s6, Input=s3, Input_6=s4, Input_7=w18) -> (Output=w26, Output_3=w23, Output_4=w24, Output_2=w19)
        w20 = default
        w21 = s1
        w22 = s2
        w25 = s5
      }
      frame "Finalize" {
        s8 = "Pass"  # shift register
        for {
          w49 = each element of s4
          Property Node(instance in=w49) -> ("Result"=w50)
          case (s8) {
            frame "Pass", Default {
              w51 = w50
            }
            frame "Fail" {
              case (w50) {
                frame Default {
                  w51 = w50
                }
                frame "Pass" {
                  w51 = s8
                }
              }
            }
            frame "Canceled" {
              w52 = "Canceled"  # Step Result
              w51 = w52
            }
          }
          next s8 = w51
        }
        call "Get Result Color.gviweb"(Input=s8) -> (Output=w53)
        Format Into String(formatString="%s", s8) -> w54
        Build Array(w54) -> w55
        # stop polling
        Property Node(instance in=reference to "Result", "TrueColor"=w53, "Text"=w55)
        $Result <- TRUE
        Property Node(instance in=reference to "Test Sequence", "Disabled"=TRUE)
        call "Report Step Complete.gviweb"(Manager Queue=w11, This Queue Name="UI", Step Name=w16, Input_3=w18) -> (Output_2=w19)
        w20 = default
        w21 = s1
        w22 = -1
        w23 = s3
        w24 = s4
        w25 = s5
        w26 = s6
      }
      frame "Finalize Complete" {
        $Finalized <- TRUE
        Property Node(instance in=reference to "Test Sequence", "Disabled"=FALSE)
        w19 = w18
        w20 = default
        w21 = s1
        w22 = s2
        w23 = s3
        w24 = s4
        w25 = s5
        w26 = s6
      }
      frame "Cancel" {
        Array Index(array=s4) -> (out0[s6]=w56)
        Property Node(instance in=w56, "Result"="Canceled") -> (instance out=w57)
        Replace Array Subset(inArray=s4, index=s6, new=w57) -> w58
        call "Handle Data Remaining in Queue.gviweb"(Input_3=reference to "Graph", Input_2=reference to "Step Status", Input_4=w6, Input_5=s6, Input=s3, Input_6=w58, Input_7=w18) -> (Output=w26, Output_3=w23, Output_4=w24, Output_2=w59)
        call "Report Step Complete.gviweb"(Manager Queue=w11, This Queue Name="UI", Step Name=w16, Input_3=w59) -> (Output_2=w19)
        w20 = default
        w21 = s1
        w22 = s2
        w25 = s5
      }
      frame "Cancel Complete" {
        w19 = w18
        w20 = default
        w21 = s1
        w22 = s2
        w23 = s3
        w24 = s4
        w25 = s5
        w26 = s6
      }
      frame "Exit" {
        Release Queue(queue=w15) -> (error out=w60)
        Release Queue(queue=w6) -> (error out=w61)
        Merge Errors(w18, w60, w61) -> (error out=w19)
        w20 = TRUE
        w21 = s1
        w22 = s2
        w23 = s3
        w24 = s4
        w25 = s5
        w26 = s6
      }
      frame Default {
        case (w14) {
          frame True {
            Wait(time to wait=500)
            call "Receive IO Data.gviweb"(Test data in=s3, Steps status in=s4, Step Index in=s6, error in=w18, IO Data Queue=w6) -> (Test data out=w23, Steps status out=w24, Step Index out=w26, error out=w19, Test Data for Graph=w62)
            $Graph <- w62
            call "Prep Step Staus for Display.gviweb"(Steps status out=w24) -> (Step Status=w63)
            $"Step Status" <- w63
          }
          frame False {
            call "Generate Undefined Message Error.gviweb"(Queue Name="UI", Message=w16, Error in=w18) -> (Error out=w19)
            w23 = s3
            w24 = s4
            w26 = s6
          }
        }
        w20 = default
        w21 = s1
        w22 = s2
        w25 = s5
      }
    }
    call "Handle Error.gviweb"(Input=w11, Input_2="UI", Output_2=w19) -> (Output_3=w64)
    next s1 = w21
    next s2 = w22
    next s3 = w23
    next s4 = w24
    next s5 = w25
    next s6 = w26
    stop if w20
  }
  Array Index(array=w9) -> (out0["Manager"]=w65, out1["IO"]=w66)
  s9 = uninitialised  # shift register
  s10 = uninitialised  # shift register
  while {
    call "Dequeue Message.gvi"(message queue in=w66, timeout in milliseconds=0, error in=w10) -> (timed out?=w67, message queue out=w68, message=w69, message data=w70, error out=w71)
    # UI Update Loop
    case (w69) ignore case {  # Message Cases
      frame "SW Init" {
        w72 = w71
        w73 = default
        w74 = s9
        w75 = "IO Data.gtype" {all zero or empty}
      }
      frame "Initialize" {
        disable {
          frame Disabled {
            # #Integrate_Hardware
            # Hardware uninitialization goes here
            w76 = w71
          }
          frame Enabled {
            call "globals.gviweb"() -> (Globals=w77)
            Property Node(instance in=w77) -> ("Hardware Initialize Duration (s)"=w78)
            # #debug
            Multiply(w78, 1000) -> w79
            Wait(time to wait=w79)
            w76 = w71
          }
        }
        call "Report Step Complete.gviweb"(Manager Queue=w65, This Queue Name="IO", Step Name=w69, Input_3=w76) -> (Output_2=w72)
        w73 = default
        w74 = s9
        w75 = s10
      }
      frame "Finalize" {
        disable {
          frame Disabled {
            # #Integrate_Hardware
            # Hardware uninitialization goes here
            w80 = w71
          }
          frame Enabled {
            call "globals.gviweb"() -> (Globals=w81)
            Property Node(instance in=w81) -> ("Hardware Finalize Duration (s)"=w82)
            # #debug
            Multiply(w82, 1000) -> w83
            Wait(time to wait=w83)
            w80 = w71
          }
        }
        call "Report Step Complete.gviweb"(Manager Queue=w65, This Queue Name="IO", Step Name=w69, Input_3=w80) -> (Output_2=w72)
        w73 = default
        w74 = s9
        w75 = s10
      }
      frame "Execute" {
        # #todo move some of this functionality to initialization and check if test sequence is empty
        # report empty back to manager
        call "Handle Next Waveform.gviweb"(Test Sequence in=$"Test Sequence", IO Data In=s10) -> (Test Sequence out=w74, IO Data out=w75)
        w72 = w71
        w73 = default
      }
      frame "Cancel" {
        sequence {
          frame 0 {
            # Stop IO
            Property Node(instance in=s10, "Wave Active"=FALSE) -> (instance out=w75)
          }
        }
        call "Report Step Complete.gviweb"(Manager Queue=w65, This Queue Name="IO", Step Name=w69, Input_3=w71) -> (Output_2=w72)
        w73 = default
        w74 = s9
      }
      frame "Exit" {
        Release Queue(queue=w68) -> (error out=w84)
        Merge Errors(w71, w84) -> (error out=w72)
        w73 = TRUE
        w74 = s9
        w75 = s10
      }
      frame Default {
        case (w67) {
          frame True {
            Property Node(instance in=s10) -> ("Wave Active"=w85, instance out=w86)
            # No message -> handle output
            case (w85) {
              frame False, Default {
                w75 = w86
                w72 = w71
                w74 = s9
              }
              frame True {
                Property Node(instance in=w86) -> ("New Wave"=w87, instance out=w88)
                case (w87) {
                  frame False, Default {
                    w89 = w88
                  }
                  frame True {
                    Get Current Time() -> (current time=w90)
                    # only save init timestamp at wave start
                    Property Node(instance in=w88, "Start Time"=w90, "New Wave"=FALSE) -> (instance out=w89)
                  }
                }
                call "Generate Waveform.gviweb"(IO Data=w89) -> (Time Elapsed=w91, IO data out=w92, Wave Value=w93, Fraction Complete=w94)
                call "Handle Hardware IO.gviweb"(IO data in=w92, Hardware output=w93, Time Elapsed=w91) -> (IO data out=w95, Hardware input=w96)
                call "Check Test Sequence Complete.gviweb"(This Queue Name="IO", Test Sequence in=s9, IO data in=w95, Fraction Complete=w94, Manager Queue=w65) -> (Test Sequence out=w74, IO data out=w75, Fraction Complete (includes messages)=w97)
                Build Array(w97, w93, w96) -> w98
                Enqueue Element(element=w98, error in=w71, queue=w6) -> (error out=w72)
              }
            }
          }
          frame False {
            # Received message
            call "Generate Undefined Message Error.gviweb"(Queue Name="IO", Message=w69, Error in=w71) -> (Error out=w72)
            w75 = s10
            w74 = s9
          }
        }
        w73 = default
      }
    }
    call "Handle Error.gviweb"(Input=w65, Input_2="IO", Output_2=w72) -> (Output_3=w99)
    Wait(time to wait=50)
    next s9 = w74
    next s10 = w75
    stop if w73
  }
  Array Index(array=w9) -> (out0["Manager"]=w100)
  call "Define Program Instructions.gviweb"() -> (Instructions=w101, Instruction names=w102)
  s11 = uninitialised  # shift register
  while {
    # w9: Message Queues
    call "Dequeue Message.gvi"(message queue in=w100, error in=w10) -> (message queue out=w103, message=w104, message data=w105, error out=w106)
    # "Manager": Manager Queue Name
    # w4: Stop Event
    # s11: Manager Data
    # w101: Instructions
    # w102: Instruction Names
    case (w104) ignore case {  # Message Cases
      frame "SW Init" {
        w107 = w106
        w108 = default
        w109 = "Manager Data.gtype" {all zero or empty}
      }
      frame "Test Sequence Change" {
        Array Index(array=w9) -> (out0["UI"]=w110)
        call "Enqueue Message (Single).gvi"(message queue in=w110, message="Handle Test Change", message data=w105, error in=w106) -> (error out=w107)
        w108 = default
        w109 = s11
      }
      frame "Error" {
        Variant To Data(error in (no error)=w106, type="Error Data.gtype" {all zero or empty}, variant=w105) -> (data=w111, error out=w112)
        Property Node(instance in=w111) -> ("Error Origin"=w113, "Error In"=w114)
        Property Node(instance in=w114) -> ("code"=w115, "source"=w116)
        w117 = "================\nError\n\nAt: %s\n\nCode: %d\n%s\n================"
        Format Into String(formatString=w117, errIn=w112, w113, w115, w116) -> (outString=w118, errOut=w119)
        call "Append Log Text.gviweb"(Message Queues in=w9, Update Tex=w118, Error in=w119) -> (Error out_2=w107)
        w108 = default
        w109 = s11
      }
      frame "Exit Pressed" {
        # #development
        s12 = w106  # shift register
        for {
          w120 = each element of w9
          call "Enqueue Message (Single).gvi"(message queue in=w120, message="Exit", error in=s12) -> (error out=w121)
          next s12 = w121
        }
        w107 = s12
        w108 = default
        w109 = s11
      }
      frame "Exit" {
        Generate User Event(event data=TRUE, user event=w4) -> (error out=w122)
        Release Queue(queue=w103) -> (error out=w123)
        Merge Errors(w123, w122) -> (error out=w107)
        w108 = TRUE
        w109 = s11
      }
      frame Default {
        call "Generate Undefined Message Error.gviweb"(Queue Name="Manager", Message=w104, Error in=w106) -> (Error out=w107)
        w108 = default
        w109 = s11
      }
      frame "Instruction" {
        # w124: Instruction Name
        Variant To Data(error in (no error)=w106, type=w104, variant=w105) -> (data=w124, error out=w125)
        Search 1D Array(1D array=w102, element=w124) -> (index of element=w126)
        case (w126) {
          frame Default {
            Array Index(array=w101) -> (out0[w126]=w127)
            Property Node(instance in=w127) -> ("Init Info:Valid Starts"=w128, instance out=w129)
            Property Node(instance in=s11) -> ("Current State"=w130, instance out=w131)
            Search 1D Array(1D array=w128, element=w130) -> (index of element=w132)
            # Message in sequence start list -> ensure in valid start state
            case (w132) {
              frame Default {
                # In valid state for recieved message -> react
                Property Node(instance in=w129) -> ("Sequences"=w133)
                Format Into String(formatString="******************\nStart: %s\n******************", errIn=w125, w124) -> (outString=w134, errOut=w135)
                call "Append Log Text.gviweb"(Message Queues in=w9, Update Tex=w134, Error in=w135) -> (Message Queues out=w136, Error out_2=w137)
                call "Handle Next Sequence.gviweb"(Manager data in=w131, Sequences=w133, error in=w137, Message Queues=w136) -> (manager data out=w138, Sequence Steps=w139, End Instruction=w140, error out=w141, Message Queues out=w142)
                case (w140) {
                  frame True {
                    # #verify - new instruction, but sequences empty
                    w143 = "-------------------------------------\nInstruction Sequences Empty\n-------------------------------------"
                    call "Append Log Text.gviweb"(Message Queues in=w142, Update Tex=w143, Error in=w141) -> (Error out_2=w107)
                    w109 = w138
                  }
                  frame False {
                    Property Node(instance in=w138, "Current Instruction"=w124) -> (instance out=w144)
                    # Start first step in first sequence
                    call "Handle Next Step.gviweb"(Manager Data in=w144, Sequence Steps=w139, Error in=w141, Nessage Queues in=w142) -> (Manager Data out=w109, Error out=w107)
                  }
                }
              }
              frame -1 {
                w145 = """-------------------------------------
Received inavalid message for current status

Invalid Message: %s

State: %s
Currently waiting on: %s
-------------------------------------"""
                Property Node(instance in=w131) -> ("Current State"=w146, "Current Step:Message Queue"=w147)
                Format Into String(formatString=w145, errIn=w125, w124, w146, w147) -> (outString=w148, errOut=w149)
                call "Append Log Text.gviweb"(Message Queues in=w9, Update Tex=w148, Error in=w149) -> (Error out_2=w107)
                w109 = w131
              }
            }
          }
          frame -1 {
            # Instruction name missing from list -> undefined
            Format Into String(formatString="Instruction \"%s\" undefined.", w124) -> w150
            call "Build Error Cluster.gvi"(code=1, description=w150, error in=w125) -> (error out=w107)
            w109 = s11
          }
        }
        w108 = default
      }
      frame "Step Complete" {
        Property Node(instance in=s11) -> ("Current Step"=w151)
        Variant To Data(error in (no error)=w106, type=w151, variant=w105) -> (data=w152, error out=w153)
        Is Equal[ComparisonMode=CompareAggregates](x=w151, y=w152) -> w154
        case (w154) {
          frame False, Default {
            w155 = "Unexpected \"Step Complete\" message \n\nFrom: %s with action %s\nExpected: %s with action %s"
            Property Node(instance in=w152) -> ("Message Queue"=w156, "Action"=w157)
            Property Node(instance in=w151) -> ("Message Queue"=w158, "Action"=w159)
            Format Into String(formatString=w155, w156, w157, w158, w159) -> w160
            call "Append Log Text.gviweb"(Message Queues in=w9, Update Tex=w160, Error in=w153) -> (Error out_2=w107)
            w109 = s11
          }
          frame True {
            # Expected complete message received
            Property Node(instance in=s11) -> ("Remaining Steps"=w161, instance out=w162)
            Array Size(array=w161) -> (size(s)=w163)
            Property Node(instance in=w151) -> ("Message Queue"=w164, "Action"=w165)
            Format Into String(formatString="Completed %s %s", errIn=w153, w164, w165) -> (outString=w166, errOut=w167)
            call "Append Log Text.gviweb"(Message Queues in=w9, Update Tex=w166, Error in=w167) -> (Message Queues out=w168, Error out_2=w169)
            case (w163) {
              frame Default {
                # Steps remaining -> handle next step
                call "Handle Next Step.gviweb"(Manager Data in=w162, Sequence Steps=w161, Error in=w169, Nessage Queues in=w168) -> (Manager Data out=w109, Error out=w107)
              }
              frame 0 {
                Property Node(instance in=w162) -> ("Remaining Sequences"=w170, "Current State"=w171, instance out=w172)
                call "Send Sequence Complete UI Updates.gviweb"(Message queues in=w168, Current State=w171, Error In=w169) -> (Message queues out=w173, Error out=w174)
                call "Handle Next Sequence.gviweb"(Manager data in=w172, Sequences=w170, error in=w174, Message Queues=w173) -> (manager data out=w175, Sequence Steps=w176, End Instruction=w177, error out=w178, Message Queues out=w179)
                Property Node(instance in=w175) -> ("Current State"=w180, instance out=w181)
                # Sequence complete -> handle next sequence if it exists
                Format Into String(formatString="%s", errIn=w178, w180) -> (outString=w182, errOut=w183)
                call "Update Program Status.gviweb"(Message Queues in=w179, Status=w182, Error in=w183) -> (Message Queues out=w184, Error out=w185)
                case (w177) {
                  frame False, Default {
                    # Handle next step of next sequence
                    call "Handle Next Step.gviweb"(Manager Data in=w181, Sequence Steps=w176, Error in=w185, Nessage Queues in=w184) -> (Manager Data out=w109, Error out=w107)
                  }
                  frame True {
                    Property Node(instance in=w181) -> ("Current Instruction"=w186, instance out=w187)
                    # No more sequences -> Instruction complete
                    # prevents confusion of manager possibly waiting on another loop
                    Property Node(instance in=w187, "Current Step:Message Queue"="Manager") -> (instance out=w109)
                    Format Into String(formatString="******************\nComplete: %s\n******************", errIn=w185, w186) -> (outString=w188, errOut=w189)
                    call "Append Log Text.gviweb"(Message Queues in=w184, Update Tex=w188, Error in=w189) -> (Error out_2=w107)
                  }
                }
              }
            }
          }
        }
        w108 = default
      }
    }
    call "Handle Error.gviweb"(Input=w103, Input_2="Manager", Output_2=w107) -> (Output_3=w190)
    next s11 = w109
    stop if w108
  }
  Register For Events("Stop Event"=w4) -> (event registration refnum out=w191)
  # #todo
  # hide exit button conditionally with flag - if possible
  # make UI more presentable
  #
  # change status text so instruction, sequence and steps are clearly identifiable
  # 	sequence not to be confused with test sequence (maybe change one to routine?)
  # create/ configure simulation cases/ flags
  # clean up
  # 	UI loop
  # 	IO loop
  # 	save all text log messages in same place
  Array Index(array=w9) -> (out0["Manager"]=w192)
  # This framework behind this sequencer operates by handling instructions (command lists) in the instruction case of the manager loop. The instruction will only begin if the manager is in a valid state to accept it. Instructions are initiated by sending an "Instruction" message via the manager's queue. The sequences in that instruction and their nested steps are then executed sequentially with the manager expecting a response to indicate each step's completion via the Report Step Complete VI. The manager will then continue on the to next step and next sequence as they're store in the sequences array via the logic in the "Step Complete" case. In each sequence element, a manager state name is defined. There's also a nested array containing the individual steps to be executed, each containing a message queue/ loop name and a message defining the action to be completed. The names of the step messages do not have to match the name of the manager state for that sequence.
  #
  # Note:
  # - The names of the step messages do not have to match the name of the manager state for that sequence.
  # - Instructions cannot be queued. There can only be one active at a time.
  # - Instruction names, start states and corresponding sequences are defined and stored in the Define Program Instructions VI, being made available to the manager at program start.
  # Run Test Sequence example
  #
  # State: Idle
  #
  # Start Pressed
  #
  # Initialize
  # 	>> To UI ---Initialize
  # 	Waiting on UI
  # 	>> To IO ---Initialize
  # 	Waiting on IO
  # Execute
  # 	>> To UI ---Execute
  # 	Waiting on UI
  # 	>> To IO ---Execute
  # 	Waiting on IO
  # Finalize
  # 	>> To IO ---Finalize
  # 	Waiting on IO
  # 	>> To UI ---Finalize
  # 	Waiting on UI
  # Idle
  s13 = w191  # shift register
  while {
    event (dynamic events = s13) {
      on "Test Start" Value changed {
        call "Enqueue Message (Single).gvi"(message queue in=w192, message="Instruction", message data="Run Test Sequence") -> (message queue out=w195, error out=w194)
        w193 = default
      }
      on "Cancel" Value changed {
        call "Enqueue Message (Single).gvi"(message queue in=w192, message="Instruction", message data="Cancel") -> (message queue out=w195, error out=w194)
        w193 = default
      }
      on "Exit (development only)" Value changed {
        call "Enqueue Message (Single).gvi"(priority message=TRUE, message queue in=w192, message="Exit Pressed") -> (message queue out=w195, error out=w194)
        w193 = default
      }
      on dynamic event 0 {
        # The Message Handling Loop processed an "Exit" message, which fired this event to stop the Event Handling Loop.
        w193 = TRUE
        w194 = default
        w195 = w192
      }
      on "Test Sequence" Value changed {
        Event Data() -> ("New Value"=w196)
        To Variant(anything=w196) -> w197
        call "Enqueue Message (Single).gvi"(message queue in=w192, message="Test Sequence Change", message data=w197) -> (message queue out=w195, error out=w194)
        w193 = default
      }
    }
    call "Error Handler - Event Handling Loop.gvi"(message queue in=w195, error in=w194) -> (dup error in=w198)
    stop if w193
  }
  Unregister For Events(error in=w198, event registration refnum=s13) -> (error out=w199)
  Merge Errors(w199, w190, w64, w99) -> (error out=w200)
  Destroy User Event(error in=w200, user event=w4)
